# Grasshopper definition RhinoPython_Fractal_Tree_for_GH.gh (Grasshopper 1.0.7)

# ---- group: 設計変数
# 0. Gene
gene_pool = GenePool(Decimals=1, Maximum=1, Minimum=0, Value=[0.4, 0.5, 0.6, 0.1, 0.7, 0.2, 0.6, 0.1, 0.7, 0.8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])

# ---- group: Generation
# 1. Generation Phase
number_slider = Slider(6, range=1..10)
file_path = FilePath("C:\Users\sho\Desktop\RhinoPython_Fractal_Tree_for_GH\generation.py")
ghpython_script = GhPythonScript(Code=file_path, MaxN=number_slider, AngleXZGene=gene_pool)  # -> Out, AllText, AllNoPt, AllBranch, AllLeaf
panel = Panel(ghpython_script.Out)
text_tag_3d = TextTag3D(Location=ghpython_script.AllNoPt, Text=ghpython_script.AllText, Size=Slider(100, range=0..1000), Justification=7)
geometry = Geometry(ghpython_script.AllBranch)

# ----
xy_plane = XYPlane(Origin="{8000,-2000,0}")
legendpar = LBLegendParameters(
    min=Slider(0, range=0..24),
    max=Slider(24, range=0..24),
    seg_count="25",
    base_plane=xy_plane,
    seg_height="450",
    seg_width="600",
    text_height="150")  # -> leg_par; plug-in component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
panel_2 = Panel(legendpar)

file_path_2 = FilePath("C:\Users\sho\Desktop\RhinoPython_Fractal_Tree_for_GH\record.py")

# ---- group: Optimization
# 3. Optimization
galapagos = Galapagos(fitness=ghpython_script_2, gene=gene_pool)

# ---- group: SunPath
file_path_3 = FilePath("C:\Users\sho\Desktop\RhinoPython_Fractal_Tree_for_GH\JPN_Tokyo.Hyakuri.477150_IWEC.epw")
# 2. Evaluation
importepw = LBImportEPW(epw_file=file_path_3)  # -> location, dry_bulb_temperature, dew_point_temperature, relative_humidity, wind_speed, wind_direction, direct_normal_rad, diffuse_horizontal_rad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; plug-in component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
analysisperiod = LBAnalysisPeriod(
    start_month=Slider(3, range=1..12),
    start_day=Slider(21, range=1..28),
    start_hour=Slider(6, range=0..23),
    end_month=Slider(3, range=1..12),
    end_day=Slider(21, range=1..28),
    end_hour=Slider(18, range=0..23))  # -> period, hoys, dates; plug-in component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
analysisperiod_2 = LBAnalysisPeriod(
    start_month=Slider(6, range=1..12),
    start_day=Slider(21, range=1..28),
    start_hour=Slider(6, range=0..23),
    end_month=Slider(6, range=1..12),
    end_day=Slider(21, range=1..28),
    end_hour=Slider(18, range=0..23))  # -> period, hoys, dates; plug-in component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
sunpath = LBSunPath(location=importepw.location, hoys=[analysisperiod_2.hoys, analysisperiod.hoys], scale="0.15")  # -> out, vectors, altitudes, azimuths, hoys, sun_pts, analemma, daily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; plug-in component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
datetime = LBHOYToDateTime(hoy=sunpath.hoys)  # -> month, day, hour, minute, date; plug-in component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
text_tag_3d_2 = TextTag3D(Location=sunpath.sun_pts, Text=datetime.date, Size="200", Justification=7)

# ----
geometry_2 = Geometry(ghpython_script.AllLeaf)
障害物 = Geometry([<brep referenced from the Rhino model> x2])
directsunhours = LBDirectSunHours(
    vectors=flatten(sunpath.vectors),
    geometry=flatten(geometry_2),
    context=flatten([障害物, geometry_2]),
    grid_size="300",
    offset_dist="1",
    legend_par=legendpar,
    parallel=Toggle(False),
    run=Toggle(True))  # -> out, points, results, mesh, legend, title, int_mtx; plug-in component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
file_path_4 = FilePath("C:\Users\sho\Desktop\RhinoPython_Fractal_Tree_for_GH\evaluation.py")
ghpython_script_2 = GhPythonScript(Code=file_path_4, Values=directsunhours.results)  # -> Out, Fitness
panel_3 = Panel(ghpython_script_2.Out)

# ---- group: Record
# 4. Record
data_recorder_fitnesses = DataRecorder(ghpython_script_2.Fitness, DataLimit=-1000, RecordData=False)
data_recorder_anglexzs = DataRecorder(gene_pool, DataLimit=-1000, RecordData=False)
ghpython_script_3 = GhPythonScript(Code=file_path_2, Fitnesses=data_recorder_fitnesses, AngleXZs=data_recorder_anglexzs, No=Slider(0, range=0..908))  # -> Out, Dic, Fitness, AngleXZGene
panel_4 = Panel(ghpython_script_3.Out)

# ---- group: 描画
# 5. Redraw
number_slider_2 = Slider(6, range=1..10)  # disabled
file_path_5 = FilePath("C:\Users\sho\Desktop\RhinoPython_Fractal_Tree_for_GH\generation.py")  # disabled
ghpython_script_4 = GhPythonScript(Code=file_path_5, MaxN=number_slider_2, AngleXZGene=ghpython_script_3.AngleXZGene)  # -> Out, AllText, AllNoPt, AllBranch, AllLeaf; disabled
number_slider_3 = Slider(100, range=0..1000)  # disabled
panel_5 = Panel(ghpython_script_4.Out)  # disabled
geometry_3 = Geometry(ghpython_script_4.AllBranch)  # disabled
text_tag_3d_3 = TextTag3D(Location=ghpython_script_4.AllNoPt, Text=ghpython_script_4.AllText, Size=number_slider_3, Justification=7)  # disabled

# ----
geometry_4 = Geometry(ghpython_script_4.AllLeaf)
